# Dynamo custom node Meshing Parameters.dyf (Dynamo 1.2.0.2690)
# category: Butterfly.00::Create
# Set meshing parameters for blockMesh and snappyHexMesh.

input_python_script = CodeBlock { "Butterfly"; "meshparams_node.py"; }
import_and_prepare_py_code = Python(IN[0]=input_python_script.out0, IN[1]=input_python_script.out1)
# ---------- import_and_prepare_py_code.python (80 lines) ----------
        
"""Find packages from Dynamo folder and prepare the code."""
import clr
from System import AppDomain, Environment, IO

def tryGetPluginPath(plugin):
    """Try to get path to plugin folder."""
    clr.AddReference('ProtoGeometry')
    _loc = tuple(a.Location
                 for a in AppDomain.CurrentDomain.GetAssemblies()
                 if 'ProtoGeometry' in a.FullName)

    try:
        _ver = float(_loc[0].split('\\')[-2])
    except:
        _ver = float(_loc[0].split('\\')[-2].split(' ')[-1])

    assert _ver >= 1.2, 'You need Dynamo 1.2 or higher to use this plugin!'

    _appdata = Environment.GetFolderPath(Environment.SpecialFolder.ApplicationData)
    _dynamoPath = '%s\\%.1f' % (('\\').join(_loc[0].split('\\')[-4:-2]), float(_loc[0].split('\\')[-2]))
    # if the assembly is cached put Revit folder first, and then try to load it from core
    _dynamoPaths = (_dynamoPath.replace('Dynamo Core', 'Dynamo Revit'),
                    _dynamoPath.replace('Dynamo Revit', 'Dynamo Core'))
    _settingsFilename = 'DynamoSettings.xml'

    pkf = []
    for path in _dynamoPaths:
        settingsFile = IO.Path.Combine(_appdata, path, _settingsFilename)
        if IO.File.Exists(settingsFile):
            with open(settingsFile, 'rb') as outf:
                for line in outf:
                    if line.strip().startswith('<CustomPackageFolders>'):
                        for l in outf:
                            if l.strip().startswith('</CustomPackageFolders>'):
                                break
                            else:
                                pkf.append(l.replace('</string>', '').replace('<string>', '').strip())

    for p in pkf:
        pp = IO.Path.Combine(p, 'packages', plugin, 'extra')
        if IO.Directory.Exists(pp):
            return pp

try:
    plugin, filename = IN
    p = tryGetPluginPath(plugin)
    if not p:
        raise ImportError('{} is not installed! Install it from package manager.'.format(plugin))
    # import the file and wrap it into sys.append
    f = IO.Path.Combine(p, 'nodesrc', filename)
    with open(f, 'rb') as inf:
        source = '    '.join(inf.readlines())

    header = 'try:\n    import sys\n' + \
        '    sys.path.append(r\'{}\')\n\n'.format(p) + \
        '    sys.path.append(r\'C:\Program Files (x86)\IronPython 2.7\Lib\')\n\n' + \
        '    '

    footer = '\nexcept Exception, e:\n' + \
        '    import traceback\n' + \
        '    OUT = "ERROR:\\n\\t{}".format(str(e)) + \\\n' + \
        '    "\\n\\nIf you think this is a bug submit an issue on github.\\n" + \\\n' + \
        '    "https://github.com/ladybug-tools/butterfly-plus/issues\\n" +  \\\n' + \
        '    "and include below error message:\\n\\n" + \\\n' + \
        '    "{}".format(traceback.format_exc())\n'

    OUT = header + source + footer

except Exception, e:
    import sys
    sys.path.append(r'C:\Program Files (x86)\IronPython 2.7\Lib')
    import traceback
    OUT = "ERROR:\n\t{}".format(str(e)) + \
        "\n\nIf you think this is a bug submit an issue on github.\n" + \
        "https://github.com/ladybug-tools/butterfly-plus/issues\n" +  \
        "and include below error message:\n\n" + \
        "{}".format(traceback.format_exc())

      
# ----------------------------------------
cellSizeXYZ = Input(_cellSizeXYZ_: Autodesk.Point = null)  # Cell size in (x, y, z) as a tuple (default: length / 5). This value updates number of divisions in blockMeshDict.
gradXYZ = Input(_gradXYZ_: var = null)  # A simpleGrading (default: simpleGrading(1, 1, 1)). This value updates grading in blockMeshDict.
locationInMesh = Input(_locationInMesh_: Autodesk.Point = null)  # A tuple for the location of the mesh to be kept. This value updates locationInMesh in snappyHexMeshDict.
globRefineLevel = Input(_globRefineLevel_: double[] = null)  # A tuple of (min, max) values for global refinment. This value updates globalRefinementLevel in snappyHexMeshDict.
core = PythonStringNode(script=import_and_prepare_py_code, IN[0]=cellSizeXYZ, IN[1]=gradXYZ, IN[2]=locationInMesh, IN[3]=globRefineLevel)
decompose_outputs = CodeBlock(out=core) { out[0]; }
meshParams = Output(decompose_outputs)  # meshingParameters.
error_report = Python(IN[0]=import_and_prepare_py_code, IN[1]=core)
# ---------- error_report.python (17 lines) ----------
        
"""Report errors"""
importErr, runErr = IN
errors = []

if importErr and str(importErr).startswith("ERROR:"):
    errors.append(importErr)

if runErr and str(runErr).startswith("ERROR:"):
    errors.append(runErr)

if len(errors)==0:
    OUT = "All good! Vvizzzz."
else:
    OUT = "\n".join(errors)

      
# ----------------------------------------
ERRReport = Output(error_report)  # Report
