# Dynamo custom node snappyHexMeshDict.dyf (Dynamo 1.2.0.2690)
# category: Butterfly.03::Mesh
# Set parameters for snappyHexMeshDict. Read more about snappyHexMeshDict here:     https://openfoamwiki.net/images/f/f0/Final-AndrewJacksonSlidesOFW7.pdf

input_python_script = CodeBlock { "Butterfly"; "snappyhexmeshdict_node.py"; }
import_and_prepare_py_code = Python(IN[0]=input_python_script.out0, IN[1]=input_python_script.out1)
# ---------- import_and_prepare_py_code.python (80 lines) ----------
        
"""Find packages from Dynamo folder and prepare the code."""
import clr
from System import AppDomain, Environment, IO

def tryGetPluginPath(plugin):
    """Try to get path to plugin folder."""
    clr.AddReference('ProtoGeometry')
    _loc = tuple(a.Location
                 for a in AppDomain.CurrentDomain.GetAssemblies()
                 if 'ProtoGeometry' in a.FullName)

    try:
        _ver = float(_loc[0].split('\\')[-2])
    except:
        _ver = float(_loc[0].split('\\')[-2].split(' ')[-1])

    assert _ver >= 1.2, 'You need Dynamo 1.2 or higher to use this plugin!'

    _appdata = Environment.GetFolderPath(Environment.SpecialFolder.ApplicationData)
    _dynamoPath = '%s\\%.1f' % (('\\').join(_loc[0].split('\\')[-4:-2]), float(_loc[0].split('\\')[-2]))
    # if the assembly is cached put Revit folder first, and then try to load it from core
    _dynamoPaths = (_dynamoPath.replace('Dynamo Core', 'Dynamo Revit'),
                    _dynamoPath.replace('Dynamo Revit', 'Dynamo Core'))
    _settingsFilename = 'DynamoSettings.xml'

    pkf = []
    for path in _dynamoPaths:
        settingsFile = IO.Path.Combine(_appdata, path, _settingsFilename)
        if IO.File.Exists(settingsFile):
            with open(settingsFile, 'rb') as outf:
                for line in outf:
                    if line.strip().startswith('<CustomPackageFolders>'):
                        for l in outf:
                            if l.strip().startswith('</CustomPackageFolders>'):
                                break
                            else:
                                pkf.append(l.replace('</string>', '').replace('<string>', '').strip())

    for p in pkf:
        pp = IO.Path.Combine(p, 'packages', plugin, 'extra')
        if IO.Directory.Exists(pp):
            return pp

try:
    plugin, filename = IN
    p = tryGetPluginPath(plugin)
    if not p:
        raise ImportError('{} is not installed! Install it from package manager.'.format(plugin))
    # import the file and wrap it into sys.append
    f = IO.Path.Combine(p, 'nodesrc', filename)
    with open(f, 'rb') as inf:
        source = '    '.join(inf.readlines())

    header = 'try:\n    import sys\n' + \
        '    sys.path.append(r\'{}\')\n\n'.format(p) + \
        '    sys.path.append(r\'C:\Program Files (x86)\IronPython 2.7\Lib\')\n\n' + \
        '    '

    footer = '\nexcept Exception, e:\n' + \
        '    import traceback\n' + \
        '    OUT = "ERROR:\\n\\t{}".format(str(e)) + \\\n' + \
        '    "\\n\\nIf you think this is a bug submit an issue on github.\\n" + \\\n' + \
        '    "https://github.com/ladybug-tools/butterfly-plus/issues\\n" +  \\\n' + \
        '    "and include below error message:\\n\\n" + \\\n' + \
        '    "{}".format(traceback.format_exc())\n'

    OUT = header + source + footer

except Exception, e:
    import sys
    sys.path.append(r'C:\Program Files (x86)\IronPython 2.7\Lib')
    import traceback
    OUT = "ERROR:\n\t{}".format(str(e)) + \
        "\n\nIf you think this is a bug submit an issue on github.\n" + \
        "https://github.com/ladybug-tools/butterfly-plus/issues\n" +  \
        "and include below error message:\n\n" + \
        "{}".format(traceback.format_exc())

      
# ----------------------------------------
meshQuality = Input(_meshQuality_: int = null)  # Use 0-2 to auto generate the parameters for meshQualityControls
castellatedMesh = Input(_castellatedMesh_: bool = true)  # Set to True to castellated mesh (default: True).
snap = Input(_snap_: bool = true)  # Set to True to snap mesh to the surfaces (default: True).
addLayers = Input(_addLayers_: bool = false)  # Set to True to push mesh away from surfaces and add layers (default: False).
nCellsBetweenLevels = Input(_nCellsBetweenLevels_: int = 3)  # Script variable snappyHexMeshDict
maxGlobalCells = Input(_maxGlobalCells_: int = 2000000)  # An intger for the maximum number of global cells (default: 2000000).
surfaceFeatureLevel = Input(_surfaceFeatureLevel_: int = null)  # An integer for the extract features refinement. Default is None which means implicit meshing feature will be used.
expansionRatio = Input(_expansionRatio_: double = 1.1)  # Layers expansion ration (default: 1.1)
finalLayerThickness = Input(_finalLayerThickness_: double = 0.7)  # Thickness of final layer (default: 0.7)
minThickness = Input(_minThickness_: double = 0.1)  # Minimum thickness for layers (default: 0.1).
nLayerIter = Input(_nLayerIter_: int = 50)  # Overall max number of layer addition iterations. The mesher will exit if it reaches this number of iterations; possibly with an illegal mesh (default: 50).
additionalParameters = Input(additionalParameters_: string = null)  # Additional parameters as a valid c++ dictionary. Additional values will overwrite the values from the other inputs above.
core = PythonStringNode(script=import_and_prepare_py_code, IN[0]=meshQuality, IN[1]=castellatedMesh, IN[2]=snap, IN[3]=addLayers, IN[4]=nCellsBetweenLevels, IN[5]=maxGlobalCells, IN[6]=surfaceFeatureLevel, IN[7]=expansionRatio, IN[8]=finalLayerThickness, IN[9]=minThickness, IN[10]=nLayerIter, IN[11]=additionalParameters)
decompose_outputs = CodeBlock(out=core) { out[0]; }
snappyHexMeshDict = Output(decompose_outputs)  # Butterfly snappyHexMeshDict.
error_report = Python(IN[0]=import_and_prepare_py_code, IN[1]=core)
# ---------- error_report.python (17 lines) ----------
        
"""Report errors"""
importErr, runErr = IN
errors = []

if importErr and str(importErr).startswith("ERROR:"):
    errors.append(importErr)

if runErr and str(runErr).startswith("ERROR:"):
    errors.append(runErr)

if len(errors)==0:
    OUT = "All good! Vvizzzz."
else:
    OUT = "\n".join(errors)

      
# ----------------------------------------
ERRReport = Output(error_report)  # Report
