# Grasshopper definition 02_0_indoor_airflow.gh (Grasshopper 1.0.4)

nutkwallfunction = Butterfly_nutkWallFunction()  # -> nutkWallFunction; plug-in component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
epsilonwallfunction = Butterfly_epsilonWallFunction(Cmu=0.09, kappa=0.4, E=9.8)  # -> epsilonWallFunction; plug-in component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
fixedvalue = Butterfly_fixedValue(value="(0 0 0)")  # -> fixedValue; plug-in component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
kqrwallfunction = Butterfly_kqRWallFunction(value="0.01")  # -> kqRWallFunction; plug-in component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
zerogradient = Butterfly_zeroGradient()  # -> zeroGradient; plug-in component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
calculated = Butterfly_calculated()  # -> calculated; plug-in component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

# ----
# Create your own boundary
# from boundary conditions
panel = Panel("patch")
panel_2 = Panel(nutkwallfunction)

# ---- group: create your own
boundary = Butterfly_Boundary(bType=panel, U=zerogradient, p=zerogradient, k=zerogradient, epsilon=calculated, nut=calculated)  # -> readMe, boundary; plug-in component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

# ----
# This file is set up in meters. If you're using a different units make sure to scale the input geometries.
panel_3 = Panel("1.2")
vec = VectorXYZ(XComponent=panel_3, YComponent=0, ZComponent=0)  # -> Vector, Length
wall = Butterfly_WallBoundary()  # -> wallBoundary; plug-in component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
outlet = Butterfly_OutletBoundary()  # -> outletBoundary; plug-in component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
inletvel = Butterfly_InletBoundary(velocityVec=vec.Vector)  # -> inletBoundary; plug-in component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

# ---- group: inlet!
srf = Surface(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)

# ---- group: walls
brep = Brep(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)

# ---- group: outlet
srf_2 = Surface([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])

# ----
# 0. CREATE BUTTERFLY SURFACES
area = Area(Geometry=srf)  # -> Area, Centroid
wires = BrepWireframe(Brep=brep, Density=-1)
preview = CustomPreview(Geometry=srf_2, Shader=ColourSwatch(SwatchColor=RGBA(255, 0, 255, 77)))
jagged = SettingsSpeed()
vdis = VectorDisplay(Anchor=area.Centroid, Vector=vec.Vector)
preview_2 = CustomPreview(Geometry=srf, Shader=ColourSwatch(SwatchColor=RGBA(136, 191, 255, 77)))
larger_than_90_to_get_the_hard_edges = Panel("castellatedMeshControls  {resolveFeatureAngle 95;}")
createbfgeometry = Butterfly_CreateButterflyGeometry(name="west_window", geo=flatten(srf), boundary=inletvel, refineLevels="(2, 2)", meshSet=jagged)  # -> readMe, BFGeometries; plug-in component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
createbfgeometry_2 = Butterfly_CreateButterflyGeometry(name="room", geo=flatten(brep), boundary=wall, meshSet=jagged)  # -> readMe, BFGeometries; plug-in component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
createbfgeometry_3 = Butterfly_CreateButterflyGeometry(name="east_window", geo=flatten(srf_2), boundary=outlet, refineLevels="(2, 2)", meshSet=jagged)  # -> readMe, BFGeometries; plug-in component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
meshparams = Butterfly_MeshingParameters(cellSizeXYZ="{0.5, 0.5, 0.5}")  # -> readMe, meshParams; plug-in component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

# ---- group: turn off the sanp to get the hard edges correctly
toggle = BooleanToggle(False)

# ----
# 1. CREATE OPENFOAM CASE
panel_4 = Panel("indoor_airflow")
snappyhexmeshdict = Butterfly_snappyHexMeshDict(
    castellatedMesh=True,
    snap=toggle,
    addLayers=False,
    nCellsBetweenLevels=3,
    maxGlobalCells=2000000,
    expansionRatio=1.1,
    finalLayerThickness=0.7,
    minThickness=0.1,
    nLayerIter=50,
    additionalParameters=larger_than_90_to_get_the_hard_edges)  # -> snappyHexMeshDict; plug-in component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
casefromgeos = Butterfly_CreateCaseFromGeometries(
    name=panel_4,
    BFGeometries=flatten([createbfgeometry_2.BFGeometries, createbfgeometry_3.BFGeometries, createbfgeometry.BFGeometries]),
    meshParams=meshparams.meshParams,
    expandBlockMesh=True,
    run=Toggle(False))  # -> readMe, blockPts, case; plug-in component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
toggle_2 = BooleanToggle(False)
panel_5 = Panel(casefromgeos.readMe)
# PURGE CASE
purgecase = Butterfly_purgeCase(case=casefromgeos.case, blockMesh=False, snappyHexMesh=False, results=toggle_2, postProcessing=toggle_2)  # -> readMe; plug-in component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
panel_6 = Panel(casefromgeos.blockPts)
genfvschemes = Butterfly_FvSchemesFromNonOrthogonality()  # -> readMe, fvSchemes; plug-in component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
# 2.1. BLOCKMESH
blockmesh = Butterfly_blockMesh(case=casefromgeos.case, overwrite=True, run=Toggle(False))  # -> readMe, case; plug-in component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

# ---- group: update inlet wind velocity
panel_7 = Panel("""boundaryField
{

west_window
    {

  
value		uniform (2.5 0.0 0.0);

}
}""")
panel_8 = Panel("U")

# ----
brep_2 = Brep(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)
brep_3 = Brep(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)
# 2. MESHING
# 2.2. SNAPPYHEXMESH
snappyhexmesh = Butterfly_snappyHexMesh(case=blockmesh.case, snappyHexMeshDict=snappyhexmeshdict, run=Toggle(False))  # -> readMe, case; plug-in component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
gentestpts = Honeybee_GenerateTestPoints(testGeometry=[brep_3, brep_2], gridSize=Slider(0.3, range=0..1), distBaseSrf="0.05", moveTestMesh=Toggle(False))  # -> readMe, simplify(testPoints), simplify(ptsVectors), simplify(facesArea), simplify(mesh); plug-in component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

# ---- group: sample the box in 3D
bbox = BoundingBox(Content=brep, Plane=PlaneXY(0, 0, 0), UnionBox=True)  # -> Box, Box_2
range = Range(Domain=Domain(0.05, 0.95), Steps=10)
crossref = CrossReference(ListA=range, ListB=range, ListC=range, CrossMode=1)  # -> ListA, ListB, ListC
box = EvaluateBox(Box=bbox.Box, UParameter=crossref.ListA, VParameter=crossref.ListB, WParameter=crossref.ListC)  # -> Plane, Point, Include

# ----
panel_9 = Panel("""p
U""")
solutionparam = Butterfly_SolutionParameter(filename=panel_8, values=panel_7, replace=False)  # -> solutionParam; plug-in component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
flatten = FlattenTree(Tree=gentestpts.mesh, Path="{0}")
flatten_2 = FlattenTree(Tree=gentestpts.testPoints, Path="{0}")
controldict = Butterfly_controlDict(startTime=0, endTime="5000", writeInterval=100, writeCompression=False, purgeWrite=0)  # -> controlDict; plug-in component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
probes = Butterfly_probes(points=flatten_2, fields=panel_9)  # -> probes; plug-in component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
decomposepardict_scotch = Butterfly_decomposeParDictScotch(numOfCpus="2")  # -> decomposeParDict; plug-in component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
# VISUALIZE MESH
loadmesh = Butterfly_LoadMesh(case=snappyhexmesh.case, innerMesh=False, load=Toggle(False))  # -> mesh; plug-in component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
solutionparams = Butterfly_SolutionParameters(controlDict=controldict, probes=probes, additionalParams=solutionparam)  # -> solutionParams; plug-in component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
steadyincomp = Butterfly_SteadyIncompressibleRecipe()  # -> readMe, recipe; plug-in component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
# Solution should be converged in 606 iterations with default settings.
toggle_3 = BooleanToggle(False)
# 3. SOLUTION
solution = Butterfly_Solution(
    case=snappyhexmesh.case,
    recipe=steadyincomp.recipe,
    solutionParams=solutionparams,
    interval=2,
    write=toggle_3,
    run=Toggle(False))  # -> readMe, solution, isRunning, timestep, residualFields, residualValues, logFiles; plug-in component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
panel_10 = Panel(solution.residualFields)
loadprobesvalue = Butterfly_LoadProbesValue(solution=solution.solution, field="p")  # -> values; plug-in component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
loadprobesvalue_2 = Butterfly_LoadProbesValue(solution=solution.solution, field="U")  # -> values; plug-in component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
panel_11 = Panel(solution.residualValues)

# ---- group: points
pt = Point(flatten_2)

# ---- group: vectors
vec_2 = Vector(loadprobesvalue_2)

# ----
rec = Rectangle({Plane=PlaneXY(1, -6, 0), Size=Domain2(u=0..15, v=0..5)})
mjoin = MeshJoin(Meshes=flatten)
# PLOT RESIDUALS
plotresiduals = Butterfly_PlotResiduals(solution=solution.solution, rect=rec, targetRes=0.0001, port=0.1, method=0, load=Toggle(False))  # -> readMe, timeRange, curves, port, residualLine, colors; plug-in component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
vlen = VectorLength(Vector=vec_2)
gradientlibrary = Ladybug_GradientLibrary(gradIndex="1")  # -> customColors; plug-in component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
bnd = Bounds(Numbers=vlen)
dedomain = DeconstructDomain(Domain=bnd)  # -> Start, End
preview_3 = CustomPreview(Geometry=plotresiduals.curves, Shader=plotresiduals.colors)
preview_4 = CustomPreview(
    Geometry=plotresiduals.residualLine,
    Shader={diffuse=RGB(255, 105, 180), emission=RGB(76, 32, 54), shine=0.5, specular=RGB(255, 255, 255), transparency=0})
panel_12 = Panel(bnd)
# 4. RESULT VISUALIZATION
legendpar = Ladybug_LegendParameters(customColors=flatten(gradientlibrary))  # -> legendPar; plug-in component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
gradient = Gradient(
    LowerLimit=dedomain.End,
    UpperLimit=dedomain.Start,
    Parameter=vlen,
    stops=[0: RGB(234, 38, 0), 0.25: RGB(234, 126, 0), 0.5: RGB(254, 244, 84), 0.75: RGB(173, 203, 249), 1: RGB(75, 107, 169)])
ladybug = Ladybug_Ladybug()  # -> Vviiiiiiiiiizzz; plug-in component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
recolormesh = Ladybug_RecolorMesh(analysisResult=loadprobesvalue, inputMesh=mjoin, legendPar=legendpar, analysisTitle="Pressure.", legendTitle="Pa.")  # -> readMe, newMesh, newLegend, legendBasePt, meshColors, legendColors; plug-in component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
scale = Slider(0.22, range=0..1)
faceb = FaceBoundaries(Mesh=recolormesh.newMesh)
multiplication = Multiplication(A=vec_2, B=scale)
preview_5 = CustomPreview(Geometry=faceb, Shader=recolormesh.meshColors)
vdisex = VectorDisplayEx(Point=pt, Vector=multiplication, Colour=gradient, Width=Slider(2, range=0..5))
