# Grasshopper definition 03_pipe_meshing.gh (Grasshopper 1.0.7)

# ---- group: outlet
mesh = Mesh(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)

# ---- group: main_pipe
mesh_2 = Mesh(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)

# ---- group: inlet
mesh_3 = Mesh(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)

# ----
# https://sites.google.com/site/snappywiki/snappyhexmesh/cylinder-case
number_slider = Slider(3, range=0..10)
createbfgeometry = Butterfly_CreateButterflyGeometry(name="main_pipe", geo=flatten(mesh_2), refine_levels="(1, 1)", n_srf_layers=number_slider)  # -> report, BF_geo; plug-in component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
createbfgeometry_2 = Butterfly_CreateButterflyGeometry(name="inlet", geo=flatten(mesh_3), n_srf_layers=number_slider)  # -> report, BF_geo; plug-in component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
createbfgeometry_3 = Butterfly_CreateButterflyGeometry(name="outlet", geo=flatten(mesh), n_srf_layers=number_slider)  # -> report, BF_geo; plug-in component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

area = Area(Geometry=mesh_2)  # -> Area, Centroid
box = CenterBox(Base=area.Centroid, X="0.5", Y="0.5", Z="2")
debrep = DeconstructBrep(Brep=box)  # -> Faces, Edges, Vertices
preview = CustomPreview(
    Geometry=debrep.Vertices,
    Shader={diffuse=RGB(255, 105, 180), emission=RGB(76, 32, 54), shine=0.5, specular=RGB(255, 255, 255), transparency=0})

casefromgeos = Butterfly_CreateCaseFromGeometries(
    name="pipe",
    BF_geo=flatten([createbfgeometry_2.BF_geo, createbfgeometry_3.BF_geo, createbfgeometry.BF_geo]),
    expand_block_mesh=True,
    run=Toggle(False))  # -> report, block_pts, case; plug-in component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
panel = Panel("""castellatedMeshControls
{
    maxLocalCells 1500000;
    maxGlobalCells 2000000;
    minRefinementCells 10
    nCellsBetweenLevels 6;

    features
    (
    );

    refinementSurfaces
    {
        cylinder
        {
            level (1 1);     
        }
    }

    resolveFeatureAngle 95;

    refinementRegions
    {
    }

}
 
snapControls
{
    nSmoothPatch 8;
    tolerance 2.0;
    nSolveIter 100;
    nRelaxIter 10;
}

addLayersControls
{
    relativeSizes true;
    expansionRatio 1.1;
    finalLayerThickness		0.7;

    minThickness		0.1;
    nGrow 1;

    // Advanced settings

    featureAngle 110;
    nRelaxIter 3;
    nSmoothSurfaceNormals 1;
    nSmoothNormals 3;
    nSmoothThickness 10;
    maxFaceThicknessRatio 0.9;
    maxThicknessToMedialRatio 0.9;
    minMedianAxisAngle 130;
    nBufferCellsNoExtrude 0;
    nLayerIter 50;
}""")
updatebmdict = Butterfly_UpdateBlockMeshDict(case=casefromgeos.case, points=debrep.Vertices, x_axis=Vector(1, 0, 0), run=Toggle(False))  # -> report, case; plug-in component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
panel_2 = Panel("{0.05, 0.05, 0.1}")
toggle = BooleanToggle(False)
blockmesh = Butterfly_blockMesh(case=updatebmdict.case, overwrite=True, write=toggle, run=toggle)  # -> report, case; plug-in component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
snappyhexmeshdict = Butterfly_snappyHexMeshDict(
    castellated_mesh=True,
    snap=True,
    add_layers=Toggle(True),
    n_cells_btwn_levels=3,
    max_global_cells=2000000,
    expansion_ratio=1.1,
    final_layer_thickness=0.7,
    min_thickness=0.1,
    n_layer_iter=50,
    additional_par=panel)  # -> snappy_hex_mesh_dict; plug-in component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
toggle_2 = BooleanToggle(False)
snappyhexmesh = Butterfly_snappyHexMesh(case=blockmesh.case, snappy_hex_mesh_dict=snappyhexmeshdict, write=toggle_2, run=toggle_2)  # -> report, case; plug-in component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
loadmesh = Butterfly_LoadMesh(case=snappyhexmesh.case, inner_mesh=False, load=Toggle(True))  # -> mesh; plug-in component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
