# Grasshopper definition 04_atrium_buoyancy.gh (Grasshopper 1.0.4)

# ---- group: Load EPW File
panel = Panel("https://www.energyplus.net/weather-download/southwest_pacific_wmo_region_5/MYS//MYS_Kuala.Lumpur.486470_IWEC/all")
epw_stat = Ladybug_OpenEPWAndSTATWeatherFiles(weatherFileURL=panel)  # -> epwFile, statFile; plug-in component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
importepw = Ladybug_ImportEpw(epwFile=epw_stat.epwFile)  # -> Output, latitude, location, dryBulbTemperature, dewPointTemperature, relativeHumidity, windSpeed, windDirection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; plug-in component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
ladybug = Ladybug_Ladybug()  # -> Vviiiiiiiiiizzz; plug-in component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

# ---- group: Butterfly Geometries
# Creating Butterfly Geometries
# Temperatures are currently assigned by hand! :)
number_slider = Slider(2, range=0..10)
strnum = Ladybug_SeparateData(inputList=flatten(importepw.dryBulbTemperature))  # -> numbers, strings; plug-in component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
doy_hoy = Ladybug_DOY_HOY(days="15", months="3", hours="13")  # -> HOY, DOY, date; plug-in component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
unit_y = UnitY(Factor=number_slider)
reverse = Reverse(Vector=unit_y)
# This file is set up in meters. If you're using a different units make sure to scale the input geometries.
panel_2 = Panel("29")
list_item = ListItem(List=strnum.numbers, Index=doy_hoy.HOY, Wrap=True)
wall = Butterfly_WallBoundary(temperature=panel_2)  # -> wallBoundary; plug-in component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
wall_2 = Butterfly_WallBoundary(temperature="29")  # -> wallBoundary; plug-in component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
wall_3 = Butterfly_WallBoundary(temperature="31")  # -> wallBoundary; plug-in component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
wall_4 = Butterfly_WallBoundary(temperature="30")  # -> wallBoundary; plug-in component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
inletvel = Butterfly_InletBoundary(velocityVec=reverse, temperature=list_item)  # -> inletBoundary; plug-in component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
wall_5 = Butterfly_WallBoundary(temperature="31")  # -> wallBoundary; plug-in component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
wall_6 = Butterfly_WallBoundary(temperature="28.5")  # -> wallBoundary; plug-in component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
wall_7 = Butterfly_WallBoundary(temperature="26.9")  # -> wallBoundary; plug-in component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
flatroof = Brep([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])
pitchedroof = Brep(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)
eastwalls_2 = Brep(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)
eastwalls_1 = Brep([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])
windowinlets = Brep([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])
westwalls_1 = Brep([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])
westwalls_2 = Brep(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)
atriumwalls = Brep([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])
createbfgeometry = Butterfly_CreateButterflyGeometry(name="FlatRoof", geo=flatten(flatroof), boundary=wall, refineLevels="(1,1)")  # -> out, BFGeometries; plug-in component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
createbfgeometry_2 = Butterfly_CreateButterflyGeometry(name="PitchedRoof", geo=flatten(pitchedroof), boundary=wall_2, refineLevels="(1,1)")  # -> out, BFGeometries; plug-in component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
createbfgeometry_3 = Butterfly_CreateButterflyGeometry(name="EastWalls_1", geo=flatten(eastwalls_1), boundary=wall_3, refineLevels="(1,1)")  # -> out, BFGeometries; plug-in component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
createbfgeometry_4 = Butterfly_CreateButterflyGeometry(name="EastWalls_2", geo=flatten(eastwalls_2), boundary=wall_4, refineLevels="(1,1)")  # -> out, BFGeometries; plug-in component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
createbfgeometry_5 = Butterfly_CreateButterflyGeometry(name="WestWalls_1", geo=flatten(westwalls_1), boundary=wall_5, refineLevels="(1,1)")  # -> out, BFGeometries; plug-in component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
createbfgeometry_6 = Butterfly_CreateButterflyGeometry(name="WindowInlets", geo=flatten(windowinlets), boundary=inletvel, refineLevels="(1,1)")  # -> out, BFGeometries; plug-in component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
createbfgeometry_7 = Butterfly_CreateButterflyGeometry(name="WestWalls_2", geo=flatten(westwalls_2), boundary=wall_6, refineLevels="(1,1)")  # -> out, BFGeometries; plug-in component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
createbfgeometry_8 = Butterfly_CreateButterflyGeometry(name="AtriumWalls", geo=flatten(atriumwalls), boundary=wall_7, refineLevels="(1,1)")  # -> out, BFGeometries; plug-in component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
outlet = Butterfly_OutletBoundary()  # -> outletBoundary; plug-in component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
wall_8 = Butterfly_WallBoundary(temperature="28.5")  # -> wallBoundary; plug-in component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
wall_9 = Butterfly_WallBoundary(temperature="25.8")  # -> wallBoundary; plug-in component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
wall_10 = Butterfly_WallBoundary(temperature="27")  # -> wallBoundary; plug-in component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
wall_11 = Butterfly_WallBoundary(temperature="29.6")  # -> wallBoundary; plug-in component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
wall_12 = Butterfly_WallBoundary(temperature="27.9")  # -> wallBoundary; plug-in component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
wall_13 = Butterfly_WallBoundary(temperature="27.9")  # -> wallBoundary; plug-in component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
wall_14 = Butterfly_WallBoundary(temperature="28.5")  # -> wallBoundary; plug-in component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
windowoutlets = Brep([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])
innerretailfloors = Brep([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])
retailfloors = Brep([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])
retailceiling = Brep([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])
northwallbottom = Brep(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)
southwall = Brep([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])
northwalltop = Brep(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)
atriumfloor = Brep(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)
createbfgeometry_9 = Butterfly_CreateButterflyGeometry(name="WindowOutlets", geo=flatten(windowoutlets), boundary=outlet, refineLevels="(1,1)")  # -> out, BFGeometries; plug-in component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
createbfgeometry_10 = Butterfly_CreateButterflyGeometry(name="RetailFloors", geo=flatten(retailfloors), boundary=wall_8, refineLevels="(1,1)")  # -> out, BFGeometries; plug-in component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
createbfgeometry_11 = Butterfly_CreateButterflyGeometry(name="InnerRetailFloors", geo=flatten(innerretailfloors), boundary=wall_9, refineLevels="(1,1)")  # -> out, BFGeometries; plug-in component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
createbfgeometry_12 = Butterfly_CreateButterflyGeometry(name="RetailCeiling", geo=flatten(retailceiling), boundary=wall_10, refineLevels="(1,1)")  # -> out, BFGeometries; plug-in component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
createbfgeometry_13 = Butterfly_CreateButterflyGeometry(name="SouthWall", geo=flatten(southwall), boundary=wall_11, refineLevels="(1,1)")  # -> out, BFGeometries; plug-in component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
createbfgeometry_14 = Butterfly_CreateButterflyGeometry(name="AtriumFloor", geo=flatten(atriumfloor), boundary=wall_12, refineLevels="(1,1)")  # -> out, BFGeometries; plug-in component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
createbfgeometry_15 = Butterfly_CreateButterflyGeometry(name="NorthWallTop", geo=flatten(northwalltop), boundary=wall_13, refineLevels="(1,1)")  # -> out, BFGeometries; plug-in component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
createbfgeometry_16 = Butterfly_CreateButterflyGeometry(name="NorthWallBottom", geo=flatten(northwallbottom), boundary=wall_14, refineLevels="(1,1)")  # -> out, BFGeometries; plug-in component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

# ----
area = Area(Geometry=windowinlets)  # -> Area, Centroid
vdis = VectorDisplay(Anchor=area.Centroid, Vector=reverse)
data = Data([createbfgeometry.BFGeometries, createbfgeometry_2.BFGeometries, createbfgeometry_3.BFGeometries, createbfgeometry_4.BFGeometries, createbfgeometry_5.BFGeometries, createbfgeometry_7.BFGeometries, createbfgeometry_8.BFGeometries, createbfgeometry_6.BFGeometries, createbfgeometry_10.BFGeometries, createbfgeometry_11.BFGeometries, createbfgeometry_12.BFGeometries, createbfgeometry_13.BFGeometries, createbfgeometry_14.BFGeometries, createbfgeometry_15.BFGeometries, createbfgeometry_16.BFGeometries, createbfgeometry_9.BFGeometries])

# ---- group: color by temperature
python = PythonScript(geos=data)  # -> mesh, temp; inputs geos: list
# ---------- python: Python ----------
mesh = (g.geometry for g in geos if g.boundary_condition.type == 'wall')
temp = (float(g.boundary_condition.T.value.split()[-1]) - 273.15 for g in geos if g.boundary_condition.type == 'wall')
# ---------- end python ----------
bnd = Bounds(Numbers=python.temp)
dedomain = DeconstructDomain(Domain=bnd)  # -> Start, End
gradient = Gradient(
    LowerLimit=dedomain.End,
    UpperLimit=dedomain.Start,
    Parameter=python.temp,
    stops=[0: RGB(234, 38, 0), 0.25: RGB(234, 126, 0), 0.5: RGB(254, 244, 84), 0.75: RGB(173, 203, 249), 1: RGB(75, 107, 169)])
mcol = MeshColours(Mesh=graft(python.mesh), Colours=graft(gradient))

# ---- group: Generate Case
casefromgeos = Butterfly_CreateCaseFromGeometries(name="AtriumStudy", BFGeometries=flatten(data), expandBlockMesh=True, run=Toggle(True))  # -> readMe, blockPts, case; plug-in component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

# ----
python_2 = PythonScript(x=python.mesh)  # -> out, a; inputs x: Mesh
# ---------- python_2: Python ----------
import Rhino

a = Rhino.Geometry.Curve.JoinCurves(tuple(e.ToNurbsCurve() for e in x.GetNakedEdges()))
# ---------- end python_2 ----------
area_2 = Area(Geometry=python_2.a)  # -> Area, simplify(Centroid)
tag = TextTag3D(Location=area_2.Centroid, Text=graft(python.temp), Size=1, Justification=5)

# ---- group: blockMesh
point = Point(Point(1, 1, 1))
blockmesh = Butterfly_blockMesh(case=casefromgeos.case, cellSizeXYZ=point, overwrite=True, run=Toggle(True))  # -> out, case; plug-in component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

# ----
avr = Average(Input=point)
decomposepardict_scotch = Butterfly_decomposeParDictScotch(numOfCpus=2)  # -> decomposeParDict; plug-in component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

# ---- group: snappyHexMesh
snappyhexmeshdict = Butterfly_snappyHexMeshDict(
    castellatedMesh=True,
    snap=True,
    addLayers=False,
    nCellsBetweenLevels=Slider(2, range=0..10),
    maxGlobalCells=Slider(4000000, range=0..10000000),
    surfaceFeatureLevel=Slider(3, range=0..10),
    expansionRatio=1.1,
    finalLayerThickness=0.7,
    minThickness=0.1,
    nLayerIter=50)  # -> snappyHexMeshDict; plug-in component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
snappyhexmesh = Butterfly_snappyHexMesh(
    case=blockmesh.case,
    locationInMesh=avr,
    snappyHexMeshDict=snappyhexmeshdict,
    decomposeParDict=decomposepardict_scotch,
    run=Toggle(False))  # -> readMe, case; plug-in component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

# ---- group: Generate Probes
section = Brep(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)
area_3 = Area(Geometry=section)  # -> Area, Centroid
scale = Scale(Geometry=section, Center=area_3.Centroid, Factor=Slider(0.93, range=0..1))  # -> Geometry, Transform
gentestpts = Honeybee_GenerateTestPoints(
    testGeometry=scale.Geometry,
    gridSize=Slider(0.5, range=0..1),
    distBaseSrf=Slider(0.005, range=0..0.01),
    moveTestMesh=True)  # -> out, simplify(testPoints), simplify(ptsVectors), simplify(facesArea), simplify(mesh); plug-in component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
panel_3 = Panel("""T
U""")
probes = Butterfly_probes(points=gentestpts.testPoints, fields=panel_3)  # -> probes; plug-in component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

# ---- group: Load Mesh
loadmesh = Butterfly_LoadMesh(case=snappyhexmesh.case, innerMesh=False, load=Toggle(False))  # -> mesh; plug-in component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
custom_preview = CustomPreview(Geometry=loadmesh, Shader=ColourSwatch(SwatchColor=RGB(0, 0, 0)))

# ----
controldict = Butterfly_controlDict(
    startTime=0,
    endTime="400",
    writeInterval=Slider(25, range=0..100),
    writeCompression=False,
    purgeWrite=Slider(2, range=0..10))  # -> controlDict; plug-in component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

# ---- group: Run Simulation
ras = Butterfly_RASTurbulanceModel(RASModel="RNGkEpsilon", turbulence=True, printCoeffs=True)  # -> RAS; plug-in component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
solutionparams = Butterfly_SolutionParameters(controlDict=controldict, probes=probes)  # -> solutionParams; plug-in component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
heattransfer = Butterfly_HeatTransferRecipe(turbulenceProp=ras)  # -> readMe, recipe; plug-in component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
solution = Butterfly_Solution(
    case=snappyhexmesh.case,
    recipe=heattransfer.recipe,
    solutionParams=solutionparams,
    interval=2,
    write=Toggle(False),
    run=Toggle(False))  # -> out, solution, isRunning, timestep, residualFields, residualValues, logFiles; plug-in component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

# ----
panel_4 = Panel(solution.residualFields)
panel_5 = Panel(solution.residualValues)

# ---- group: Post-process results (Temperature)
# Post-process results
panel_6 = Panel("T")
loadprobesvalue = Butterfly_LoadProbesValue(solution=solution.solution, field=panel_6)  # -> values; plug-in component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
subtraction = Subtraction(A=loadprobesvalue, B="273.15")
recolormesh = Ladybug_RecolorMesh(analysisResult=subtraction, inputMesh=gentestpts.mesh, legendTitle="C")  # -> out, newMesh, newLegend, legendBasePt, meshColors, legendColors; plug-in component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

# ----
loadprobesvalue_2 = Butterfly_LoadProbesValue(solution=solution.solution, field="U")  # -> values; plug-in component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
multiplication = Multiplication(A=loadprobesvalue_2, B=Slider(0.8, range=0..1))
vdisex = VectorDisplayEx(Point=gentestpts.testPoints, Vector=multiplication, Colour=RGB(0, 0, 0), Width=2)
