# Grasshopper definition 05_hvac.gh (Grasshopper 1.0.7)

# ----
# This file is set up in meters. If you're using a different units make sure to scale the input geometries.
outlet = Butterfly_OutletBoundary()  # -> outlet_boundary; plug-in component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
brep = Brep(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)
createbfgeometry = Butterfly_CreateButterflyGeometry(name="outlet", geo=flatten(brep), boundary=outlet, refine_levels="5, 5")  # -> report, BF_geo; plug-in component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

inletvol = Butterfly_InletFlowRateBoundary(vol_flow_rate="0.1", temperature="23")  # -> inlet_boundary; plug-in component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
brep_2 = Brep([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])
createbfgeometry_2 = Butterfly_CreateButterflyGeometry(name="inlets", geo=flatten(brep_2), boundary=inletvol, refine_levels="5, 5")  # -> report, BF_geo; plug-in component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

wall = Butterfly_WallBoundary(temperature="25")  # -> wall_boundary; plug-in component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
brep_3 = Brep([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])
createbfgeometry_3 = Butterfly_CreateButterflyGeometry(name="fcu_structure", geo=flatten(brep_3), boundary=wall, refine_levels="5, 5")  # -> report, BF_geo; plug-in component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

wall_2 = Butterfly_WallBoundary(temperature="30")  # -> wall_boundary; plug-in component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
brep_4 = Brep([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])
createbfgeometry_4 = Butterfly_CreateButterflyGeometry(name="walls_and_floor", geo=flatten(brep_4), boundary=wall_2, refine_levels="3, 3")  # -> report, BF_geo; plug-in component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

wall_3 = Butterfly_WallBoundary(temperature="35")  # -> wall_boundary; plug-in component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
brep_5 = Brep([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])
createbfgeometry_5 = Butterfly_CreateButterflyGeometry(name="ceiling", geo=flatten(brep_5), boundary=wall_3, refine_levels="3, 3")  # -> report, BF_geo; plug-in component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

wires = BrepWireframe(Brep=[brep_4, brep_5, brep_3], Density=-1)
preview = CustomPreview(Geometry=brep_2, Shader=ColourSwatch(SwatchColor=RGBA(27, 144, 201, 124)))
preview_2 = CustomPreview(Geometry=brep, Shader=ColourSwatch(SwatchColor=RGBA(255, 0, 76, 124)))

bbox = BoundingBox(Content=brep_4, Plane=PlaneXY(0, 0, 0), UnionBox=True)  # -> Box, Box_2
debrep = DeconstructBrep(Brep=bbox.Box)  # -> Faces, Edges, Vertices
area = Area(Geometry=debrep.Faces)  # -> Area, Centroid
pdecon = Deconstruct(Point=area.Centroid)  # -> XComponent, YComponent, ZComponent
panel = Panel("""0
1""")
sort = SortList(Keys=pdecon.ZComponent, ValuesA=debrep.Faces)  # -> Keys, ValuesA
item = ListItem(List=sort.Keys, Index="-1", Wrap=True)
item_2 = ListItem(List=sort.ValuesA, Index=0, Wrap=True)
pt = ConstructPoint(XCoordinate=panel, YCoordinate="0.5", ZCoordinate=0)
evalsrf = EvaluateSurface(Surface=reparameterize(item_2), Point=pt)  # -> Point, Normal, Frame
item_3 = ListItem(List=evalsrf.Point, Index=0, Wrap=True)  # -> Item, Item1
Z = UnitZ(Factor=Slider(0.6, range=0..10))
Z_2 = UnitZ(Factor=item)
ln = Line(StartPoint=item_3.Item, EndPoint=item_3.Item1)
extr = Extrude(Base=ln, Direction=Z_2)
move = Move(Geometry=item_2, Motion=Z)  # -> Geometry, Transform

casefromgeos = Butterfly_CreateCaseFromGeometries(
    name="simple_hvac",
    BF_geo=flatten([createbfgeometry.BF_geo, createbfgeometry_2.BF_geo, createbfgeometry_3.BF_geo, createbfgeometry_5.BF_geo, createbfgeometry_4.BF_geo]),
    expand_block_mesh=True,
    run=Toggle(False))  # -> report, block_pts, case; plug-in component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
snappyhexmeshdict = Butterfly_snappyHexMeshDict(
    castellated_mesh=True,
    snap=True,
    add_layers=False,
    n_cells_btwn_levels=3,
    max_global_cells=2000000,
    expansion_ratio=1.1,
    final_layer_thickness=0.7,
    min_thickness=0.1,
    n_layer_iter=50)  # -> snappy_hex_mesh_dict; plug-in component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
# 2.1. BLOCKMESH
blockmesh = Butterfly_blockMesh(case=casefromgeos.case, overwrite=True, write=Toggle(False), run=Toggle(False))  # -> report, case; plug-in component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
# 2. MESHING
# 2.2. SNAPPYHEXMESH
snappyhexmesh = Butterfly_snappyHexMesh(case=blockmesh.case, snappy_hex_mesh_dict=snappyhexmeshdict, write=Toggle(False), run=Toggle(False))  # -> report, case; plug-in component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
gentestpts = Honeybee_GenerateTestPoints(testGeometry=[extr, move.Geometry], gridSize=Slider(0.1, range=0..1), distBaseSrf="0.05", moveTestMesh=Toggle(False))  # -> readMe, simplify(testPoints), simplify(ptsVectors), simplify(facesArea), simplify(mesh); plug-in component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
flatten = FlattenTree(Tree=gentestpts.mesh, Path="{0}")
flatten_2 = FlattenTree(Tree=gentestpts.testPoints, Path="{0}")
loadmesh = Butterfly_LoadMesh(case=snappyhexmesh.case, inner_mesh=False, load=Toggle(False))  # -> mesh; plug-in component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
controldict = Butterfly_controlDict(start_time=0, end_time="1000", write_interval=100, write_compression=False, purge_write=0)  # -> control_dict; plug-in component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
decomposepardict_scotch = Butterfly_decomposeParDictScotch(num_of_cpus="2")  # -> decompose_par_dict; plug-in component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
panel_2 = Panel("""T
U""")
probes = Butterfly_probes(points=flatten_2, fields=panel_2)  # -> probes; plug-in component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
heattransfer = Butterfly_HeatTransferRecipe()  # -> report, recipe; plug-in component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
solutionparams = Butterfly_SolutionParameters(control_dict=controldict, probes=probes)  # -> solution_par; plug-in component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
# 3. SOLUTION
solution = Butterfly_Solution(
    case=snappyhexmesh.case,
    recipe=heattransfer.recipe,
    solution_par=solutionparams,
    interval=2,
    write=Toggle(False),
    run=Toggle(False))  # -> report, solution, is_running, timestep, residual_fields, residual_values, log_files; plug-in component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
panel_3 = Panel(solution.residual_fields)
loadprobesvalue = Butterfly_LoadProbesValue(solution=solution.solution, field="T")  # -> values; plug-in component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
loadprobesvalue_2 = Butterfly_LoadProbesValue(solution=solution.solution, field="U")  # -> values; plug-in component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
panel_4 = Panel(solution.residual_values)

rec = Rectangle({Plane=PlaneXY(2.141855102, 10.24315805, 0), Size=Domain2(u=0..10.56375196, v=0..3.31523504)})
# PLOT RESIDUALS
plotresiduals = Butterfly_PlotResiduals(solution=solution.solution, rect=rec, target_res=0.0001, port=0.1, method=0, load=Toggle(False))  # -> report, time_range, curves, port, residual_line, colors; plug-in component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
preview_3 = CustomPreview(Geometry=plotresiduals.curves, Shader=plotresiduals.colors)
preview_4 = CustomPreview(
    Geometry=plotresiduals.residual_line,
    Shader={diffuse=RGB(255, 105, 180), emission=RGB(76, 32, 54), shine=0.5, specular=RGB(255, 255, 255), transparency=0})

# ---- group: points
pt_2 = Point(flatten_2)

# ---- group: vectors
vec = Vector(loadprobesvalue_2)

# ----
vlen = VectorLength(Vector=vec)
bnd = Bounds(Numbers=vlen)
dedomain = DeconstructDomain(Domain=bnd)  # -> Start, End
gradient = Gradient(
    LowerLimit=dedomain.End,
    UpperLimit=dedomain.Start,
    Parameter=vlen,
    stops=[0: RGB(234, 38, 0), 0.25: RGB(234, 126, 0), 0.5: RGB(254, 244, 84), 0.75: RGB(173, 203, 249), 1: RGB(75, 107, 169)])
scale = Slider(0.31, range=0..1)
multiplication = Multiplication(A=vec, B=scale)
vdisex = VectorDisplayEx(Point=pt_2, Vector=multiplication, Colour=gradient, Width=Slider(2, range=0..5))

# ----
# 4. RESULT VISUALIZATION
mjoin = MeshJoin(Meshes=flatten)
gradientlibrary = Ladybug_GradientLibrary(gradIndex="7")  # -> customColors; plug-in component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
legendpar = Ladybug_LegendParameters(customColors=flatten(gradientlibrary))  # -> legendPar; plug-in component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
subtraction = Subtraction(A=loadprobesvalue, B="273.15")
recolormesh = Ladybug_RecolorMesh(analysisResult=subtraction, inputMesh=mjoin, legendPar=legendpar, analysisTitle="Temperature", legendTitle="C")  # -> readMe, newMesh, newLegend, legendBasePt, meshColors, legendColors; plug-in component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
ladybug = Ladybug_Ladybug()  # -> Vviiiiiiiiiizzz; plug-in component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
faceb = FaceBoundaries(Mesh=recolormesh.newMesh)
mesh = Mesh(recolormesh.newLegend)
