# Grasshopper definition 03_pipe_meshing.gh (Grasshopper 0.9.76)
# plug-ins: Python Interpreter

# ---- group: outlet
mesh = Mesh(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)

# ---- group: main_pipe
mesh_2 = Mesh(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)

# ---- group: inlet
mesh_3 = Mesh(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)

# ----
number_slider = Slider(3, range=0..10)
# https://sites.google.com/site/snappywiki/snappyhexmesh/cylinder-case
panel = Panel("main_pipe")
createbfgeometry = Butterfly_CreateButterflyGeometry(name=panel, geo=flatten(mesh_2), refineLevels="(1, 1)", nSrfLayers=number_slider)  # -> readMe, BFGeometries; plug-in component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
createbfgeometry_2 = Butterfly_CreateButterflyGeometry(name="inlet", geo=flatten(mesh_3), nSrfLayers=number_slider)  # -> readMe, BFGeometries; plug-in component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
createbfgeometry_3 = Butterfly_CreateButterflyGeometry(name="outlet", geo=flatten(mesh), nSrfLayers=number_slider)  # -> readMe, BFGeometries; plug-in component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
number_slider_2 = Slider(3, range=0..10)
number_slider_3 = Slider(7.4, range=0..10)
area = Area(Geometry=mesh_2)  # -> Area, Centroid
casefromgeos = Butterfly_CreateCaseFromGeometries(
    name="pipe",
    BFGeometries=flatten([createbfgeometry_2.BFGeometries, createbfgeometry_3.BFGeometries, createbfgeometry.BFGeometries]),
    expandBlockMesh=True,
    run=Toggle(False))  # -> readMe, blockPts, case; plug-in component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
box = CenterBox(Base=area.Centroid, X="0.5", Y="0.5", Z="2")
debrep = DeconstructBrep(Brep=box)  # -> Faces, Edges, Vertices
preview = CustomPreview(
    Geometry=debrep.Vertices,
    Shader={ambient=RGB(0, 0, 0), diffuse=RGB(255, 105, 180), emission=RGB(76, 32, 54), shine=0.5, specular=RGB(255, 255, 255), transparency=0})
panel_2 = Panel("""castellatedMeshControls
{
    maxLocalCells 1500000;
    maxGlobalCells 2000000;
    minRefinementCells 10
    nCellsBetweenLevels 6;

    features
    (
    );

    refinementSurfaces
    {
        cylinder
        {
            level (1 1);     
        }
    }

    resolveFeatureAngle 95;

    refinementRegions
    {
    }

}
 
snapControls
{
    nSmoothPatch 8;
    tolerance 2.0;
    nSolveIter 100;
    nRelaxIter 10;
}

addLayersControls
{
    relativeSizes true;
    expansionRatio 1.1;
    finalLayerThickness		0.7;

    minThickness		0.1;
    nGrow 1;

    // Advanced settings

    featureAngle 110;
    nRelaxIter 3;
    nSmoothSurfaceNormals 1;
    nSmoothNormals 3;
    nSmoothThickness 10;
    maxFaceThicknessRatio 0.9;
    maxThicknessToMedialRatio 0.9;
    minMedianAxisAngle 130;
    nBufferCellsNoExtrude 0;
    nLayerIter 50;
}""")
updatebmdict = Butterfly_UpdateBlockMeshDict(case=casefromgeos.case, points=debrep.Vertices, xAxis=Vector(1, 0, 0), run=Toggle(True))  # -> readMe, case; plug-in component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
blockmesh = Butterfly_blockMesh(case=updatebmdict.case, cellSizeXYZ="{0.05, 0.05, 0.1}", overwrite=True, run=Toggle(True))  # -> readMe, case; plug-in component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
snappyhexmeshdict = Butterfly_snappyHexMeshDict(
    castellatedMesh=True,
    snap=True,
    addLayers=Toggle(True),
    nCellsBetweenLevels=3,
    maxGlobalCells=2000000,
    expansionRatio=1.1,
    finalLayerThickness=0.7,
    minThickness=0.1,
    nLayerIter=50,
    additionalParameters=panel_2)  # -> snappyHexMeshDict; plug-in component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
snappyhexmesh = Butterfly_snappyHexMesh(case=blockmesh.case, snappyHexMeshDict=snappyhexmeshdict, run=Toggle(True))  # -> readMe, case; plug-in component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
loadmesh = Butterfly_LoadMesh(case=snappyhexmesh.case, innerMesh=False, load=Toggle(True))  # -> mesh; plug-in component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
faceb = FaceBoundaries(Mesh=loadmesh)
preview_2 = CustomPreview(Geometry=faceb, Shader=ColourSwatch(SwatchColor=RGB(14, 0, 73)))
