# Grasshopper definition 05_hvac.gh (Grasshopper 0.9.76)
# plug-ins: Python Interpreter

wall = Butterfly_WallBoundary(temperature="35")  # -> wallBoundary; plug-in component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
wall_2 = Butterfly_WallBoundary(temperature="25")  # -> wallBoundary; plug-in component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
outlet = Butterfly_OutletBoundary()  # -> outletBoundary; plug-in component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
inletvol = Butterfly_InletFlowRateBoundary(volFlowRate="0.1", temperature="23")  # -> inletBoundary; plug-in component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
wall_3 = Butterfly_WallBoundary(temperature="30")  # -> wallBoundary; plug-in component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
# This file is set up in meters. If you're using a different units make sure to scale the input geometries.
panel = Panel("outlet")
brep = Brep([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])
brep_2 = Brep([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])
brep_3 = Brep([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])
brep_4 = Brep(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)
brep_5 = Brep([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])
createbfgeometry = Butterfly_CreateButterflyGeometry(name="fcu_structure", geo=flatten(brep), boundary=wall_2, refineLevels="5, 5")  # -> readMe, BFGeometries; plug-in component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
createbfgeometry_2 = Butterfly_CreateButterflyGeometry(name=panel, geo=flatten(brep_4), boundary=outlet, refineLevels="5, 5")  # -> readMe, BFGeometries; plug-in component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
createbfgeometry_3 = Butterfly_CreateButterflyGeometry(name="inlets", geo=flatten(brep_2), boundary=inletvol, refineLevels="5, 5")  # -> readMe, BFGeometries; plug-in component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
createbfgeometry_4 = Butterfly_CreateButterflyGeometry(name="ceiling", geo=flatten(brep_5), boundary=wall, refineLevels="3, 3")  # -> readMe, BFGeometries; plug-in component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
createbfgeometry_5 = Butterfly_CreateButterflyGeometry(name="walls_and_floor", geo=flatten(brep_3), boundary=wall_3, refineLevels="3, 3")  # -> readMe, BFGeometries; plug-in component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
preview = CustomPreview(Geometry=brep_2, Shader=ColourSwatch(SwatchColor=RGBA(27, 144, 201, 124)))
preview_2 = CustomPreview(Geometry=brep_4, Shader=ColourSwatch(SwatchColor=RGBA(255, 0, 76, 124)))
bbox = BoundingBox(Content=brep_3, Plane=PlaneXY(0, 0, 0), UnionBox=True)  # -> Box, Box_2
wires = BrepWireframe(Brep=[brep_3, brep_5, brep], Density=-1)
debrep = DeconstructBrep(Brep=bbox.Box)  # -> Faces, Edges, Vertices
area = Area(Geometry=debrep.Faces)  # -> Area, Centroid
pdecon = Deconstruct(Point=area.Centroid)  # -> XComponent, YComponent, ZComponent
panel_2 = Panel("""0
1""")
sort = SortList(Keys=pdecon.ZComponent, ValuesA=debrep.Faces)  # -> Keys, ValuesA
meshparams = Butterfly_MeshingParameters(cellSizeXYZ="{0.3, 0.3, 0.3}")  # -> readMe, meshParams; plug-in component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
item = ListItem(List=sort.Keys, Index="-1", Wrap=True)
item_2 = ListItem(List=sort.ValuesA, Index=0, Wrap=True)
pt = ConstructPoint(XCoordinate=panel_2, YCoordinate="0.5", ZCoordinate=0)
evalsrf = EvaluateSurface(Surface=reparameterize(item_2), Point=pt)  # -> Point, Normal, Frame
item_3 = ListItem(List=evalsrf.Point, Index=0, Wrap=True)  # -> Item, Item1
casefromgeos = Butterfly_CreateCaseFromGeometries(
    name="simple_hvac",
    BFGeometries=flatten([createbfgeometry_2.BFGeometries, createbfgeometry_3.BFGeometries, createbfgeometry.BFGeometries, createbfgeometry_4.BFGeometries, createbfgeometry_5.BFGeometries]),
    meshParams=meshparams.meshParams,
    expandBlockMesh=True,
    run=Toggle(False))  # -> readMe, blockPts, case; plug-in component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
Z = UnitZ(Factor=Slider(0.6, range=0..10))
Z_2 = UnitZ(Factor=item)
ln = Line(StartPoint=item_3.Item, EndPoint=item_3.Item1)
extr = Extrude(Base=ln, Direction=Z_2)
move = Move(Geometry=item_2, Motion=Z)  # -> Geometry, Transform
snappyhexmeshdict = Butterfly_snappyHexMeshDict(
    castellatedMesh=True,
    snap=True,
    addLayers=False,
    nCellsBetweenLevels=3,
    maxGlobalCells=2000000,
    expansionRatio=1.1,
    finalLayerThickness=0.7,
    minThickness=0.1,
    nLayerIter=50)  # -> snappyHexMeshDict; plug-in component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
# 2.1. BLOCKMESH
blockmesh = Butterfly_blockMesh(case=casefromgeos.case, overwrite=True, run=Toggle(False))  # -> readMe, case; plug-in component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
# 2. MESHING
# 2.2. SNAPPYHEXMESH
snappyhexmesh = Butterfly_snappyHexMesh(case=blockmesh.case, snappyHexMeshDict=snappyhexmeshdict, run=Toggle(False))  # -> readMe, case; plug-in component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
loadmesh = Butterfly_LoadMesh(case=snappyhexmesh.case, innerMesh=False, load=Toggle(False))  # -> mesh; plug-in component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
panel_3 = Panel("350")
gentestpts = Honeybee_GenerateTestPoints(testGeometry=[extr, move.Geometry], gridSize=Slider(0.1, range=0..1), distBaseSrf="0.05", moveTestMesh=Toggle(False))  # -> readMe, simplify(testPoints), simplify(ptsVectors), simplify(facesArea), simplify(mesh); plug-in component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
flatten = FlattenTree(Tree=gentestpts.mesh, Path="{0}")
flatten_2 = FlattenTree(Tree=gentestpts.testPoints, Path="{0}")
decomposepardict_scotch = Butterfly_decomposeParDictScotch(numOfCpus="2")  # -> decomposeParDict; plug-in component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
panel_4 = Panel("""T
U""")
controldict = Butterfly_controlDict(startTime=0, endTime="1000", writeInterval=100, writeCompression=False, purgeWrite=0)  # -> controlDict; plug-in component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
probes = Butterfly_probes(points=flatten_2, fields=panel_4)  # -> probes; plug-in component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
heattransfer = Butterfly_HeatTransferRecipe()  # -> readMe, recipe; plug-in component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
solutionparams = Butterfly_SolutionParameters(controlDict=controldict, probes=probes)  # -> solutionParams; plug-in component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
# 3. SOLUTION
solution = Butterfly_Solution(
    case=snappyhexmesh.case,
    recipe=heattransfer.recipe,
    solutionParams=solutionparams,
    interval=2,
    write=Toggle(False),
    run=Toggle(False))  # -> readMe, solution, isRunning, timestep, residualFields, residualValues, logFiles; plug-in component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
panel_5 = Panel(solution.residualFields)
loadprobesvalue = Butterfly_LoadProbesValue(solution=solution.solution, field="T")  # -> values; plug-in component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
loadprobesvalue_2 = Butterfly_LoadProbesValue(solution=solution.solution, field="U")  # -> values; plug-in component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
panel_6 = Panel(solution.residualValues)

# ---- group: points
pt_2 = Point(flatten_2)

# ---- group: vectors
vec = Vector(loadprobesvalue_2)

# ----
rec = Rectangle({Plane=PlaneXY(2.141855102, 10.24315805, 0), Size=Domain2(u=0..10.56375196, v=0..3.31523504)})
mjoin = MeshJoin(Meshes=flatten)
# PLOT RESIDUALS
plotresiduals = Butterfly_PlotResiduals(solution=solution.solution, rect=rec, targetRes=0.0001, port=0.1, method=0, load=Toggle(False))  # -> readMe, timeRange, curves, port, residualLine, colors; plug-in component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
gradientlibrary = Ladybug_GradientLibrary(gradIndex="1")  # -> customColors; plug-in component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
# 4. RESULT VISUALIZATION
subtraction = Subtraction(A=loadprobesvalue, B="273.15")
preview_3 = CustomPreview(Geometry=plotresiduals.curves, Shader=plotresiduals.colors)
preview_4 = CustomPreview(
    Geometry=plotresiduals.residualLine,
    Shader={ambient=RGB(0, 0, 0), diffuse=RGB(255, 105, 180), emission=RGB(76, 32, 54), shine=0.5, specular=RGB(255, 255, 255), transparency=0})
legendpar = Ladybug_LegendParameters(customColors=flatten(gradientlibrary))  # -> legendPar; plug-in component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
ladybug = Ladybug_Ladybug()  # -> Vviiiiiiiiiizzz; plug-in component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
recolormesh = Ladybug_RecolorMesh(analysisResult=subtraction, inputMesh=mjoin, legendPar=legendpar, analysisTitle="Temp.", legendTitle="C")  # -> readMe, newMesh, newLegend, legendBasePt, meshColors, legendColors; plug-in component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
scale = Slider(1, range=0..1)
multiplication = Multiplication(A=vec, B=scale)
vdisex = VectorDisplayEx(Point=pt_2, Vector=multiplication, Colour=ColourSwatch(SwatchColor=RGB(104, 111, 110)), Width=Slider(2, range=0..5))
